vi "main.gviweb"   [LabVIEW NXG 4.0.0]
panel controls:
  "error in": error
  "Power Button": bool
panel indicators:
  "Card_1": T1
  "Card_2": T1
  "Card_3": T1
  "Card_4": T1
  "Card_5": T1
  "Card_6": T1
  "Card_7": T1
  "Card_8": T1
  "dockBar": string
  "URL Image": string
  "freeNum": string
  "URL Image_2": string
  "busyNum": string
  "URL Image_3": string
  "awayNum": string
  "URL Image_4": string
  "Talks": string
  "errror out": error
  "Time": string
  "Date": string
types:
  T1 = cluster{"AE-Photo": string, "Radial Progress Bar": f64, "CurrentStatePeriod": string, "FullName": string, "ColorCircle": string, "CardBackground": string}
uses:
  SubVIs::createBasicTag.gvi
  SubVIs::readBasicTag.gvi
  SubVIs::createCardTag.gvi
  SubVIs::readCardTag.gvi
  NI::Skyline::TagHTTP::Close Tag (Multiple).gvi
  SubVIs::DateAndTime.gvi
diagram:
  w1 = $"error in"
  while {
    call "createBasicTag.gvi"(server url="http://sh-ae-board", username="admin", password="Dashboard", error in=w1) -> (tags=w2, error out=w3)
    call "readBasicTag.gvi"(tags in=w2, error in=w3) -> (Output=w4, errror out=w5)
    Array To Cluster[NumberOfClusterElements=6](array=w4) -> (cluster=w6)
    Property Node(instance in=w6) -> ("Element 1"=w7, "Element 2"=w8, "Element 3"=w9, "Element 4"=w10)
    $awayNum <- w9
    Build Array(reference to "Card_1", reference to "Card_2", reference to "Card_3", reference to "Card_4", reference to "Card_5", reference to "Card_6", reference to "Card_7", reference to "Card_8") -> w11
    for (N = 8) (iteration -> i1) {
      w12 = each element of w11
      Increment(x=i1) -> w13
      call "createCardTag.gvi"(server url="http://sh-ae-board", username="admin", password="Dashboard", error in=w1, Card No=w13) -> (tags=w14, error out=w15)
      call "readCardTag.gvi"(tags in=w14, error in=w15) -> (tags out=w16, state cluster=w17, errror out=w18)
      Property Node(instance in=w17) -> ("Element 1"=w19, "Element 2"=w20, "Element 3"=w21, "Element 4"=w22, "Element 5"=w23, "Element 6"=w24)
      Decimal String To Number(string=w10) -> (number=w25)
      Divide(x=w21, y=w25) -> w26: f64
      Build Cluster(w24, w26, w23, w20, w22, "Resources/CardBG.png") -> w27
      Property Node(instance in=w12, "Value"=w27, "Visible"=w19)
      call "Close Tag (Multiple).gvi"(tags=w16, error in=w18)
    }
    $Talks <- w10
    $freeNum <- w7
    $busyNum <- w8
    stop if $"Power Button"
  }
  while {
    call "DateAndTime.gvi"(Error In=w1) -> (Date=w28, Time=w29, Error Out=w30)
    $Date <- w28
    $Time <- w29
    Wait(time to wait=1000)
    stop if $"Power Button"
  }
  Merge Errors(w5, w30) -> (error out=w31)
  $"errror out" <- w31
  Build Cluster("Photos/Sha%20Wang.jpg", 33, "09:55", "Yi Xu", "Resources/greenCircle.png", "Resources/CardBG.png") -> w32
  $Card_1 <- w32
  $Card_2 <- w32
  $Card_3 <- w32
  $Card_4 <- w32
  $Card_5 <- w32
  $Card_6 <- w32
  $Card_7 <- w32
  $Card_8 <- w32
