vi "DateAndTime.gvi"   [LabVIEW NXG 4.0.0]
inputs:
  "Error In": error
outputs:
  "Error Out": error
  "Time": string
  "Date": string
uses:
  SubVIs::One2Two.gvi
diagram:
  sequence {
    frame 0 {
      Get Current Time() -> (current time=w1)
      Timestamp To Date And Time(time stamp=w1) -> (date time rec=w2)
      Property Node(instance in=w2) -> ("minute"=w3, "hour"=w4, "day of month"=w5, "month"=w6, "year"=w7, "second"=w8)
      sequence {
        frame 0 {
          # Day
          Number To Decimal String(number=w5, width (-)=2) -> (decimal integer string=w9)
        }
      }
      sequence {
        frame 0 {
          Build Array("Dec", "Jan", "Feb", "Mar", "Apr", "May", "Jun", "Jul", "Aug", "Sep", "Oct", "Nov") -> w10
          Quotient And Remainder(x=w6, y=12) -> (x-y*floor(x/y)=w11)
          # Month
          Array Index(array=w10) -> (out0[w11]=w12)
        }
      }
      sequence {
        frame 0 {
          # Year
          Number To Decimal String(number=w7) -> (decimal integer string=w13)
        }
      }
      sequence {
        frame 0 {
          Concatenate Strings(w9, " ", w12, " ", w13) -> w14
          # Date
          $Date <- w14
        }
      }
      sequence {
        frame 0 {
          Number To Decimal String(number=w4) -> (decimal integer string=w15)
          # Hour
          call "One2Two.gvi"(十进制整型字符串=w15) -> (输出=w16)
        }
      }
      sequence {
        frame 0 {
          Number To Decimal String(number=w3) -> (decimal integer string=w17)
          # Minute
          call "One2Two.gvi"(十进制整型字符串=w17) -> (输出=w18)
        }
      }
      sequence {
        frame 0 {
          Number To Decimal String(number=w8) -> (decimal integer string=w19)
          # Second
          call "One2Two.gvi"(十进制整型字符串=w19) -> (输出=w20)
        }
      }
      sequence {
        frame 0 {
          Concatenate Strings(" ", w16, ":", w18, ":", w20, " ") -> w21
          # Time
          $Time <- w21
        }
      }
    }
  }
  $"Error Out" <- $"Error In"
