vi "createBasicTag.gvi"   [LabVIEW NXG 4.0.0]
inputs:
  "configuration": "Configuration.gtype"
  "error in": error
outputs:
  "error out": error
  "tags": "Tag.gtype"[]
types:
  "DataType.gtype" = enum{"Double", "I32", "String", "Boolean", "U64", "Timestamp"}
  "Client Handle.gtype" = u32
  "Configuration.gtype" = cluster{"Server URL": string, "Session": "Client Handle.gtype"}
  "Tag.gtype" = cluster{"Path": string, "Datatype": "DataType.gtype", "Configuration": "Configuration.gtype"}
uses:
  NI::Skyline::TagHTTP::Open Tag.gvi
diagram:
  w1 = ["SystemLink.Dashboard.Basic.TimeStamp", "SystemLink.Dashboard.Basic.freeNum", "SystemLink.Dashboard.Basic.busyNum", "SystemLink.Dashboard.Basic.awayNum", "SystemLink.Dashboard.Basic.allTalks", "SystemLink.Dashboard.Basic.waitNum"]
  Build Array("String", "String", "String", "String", "String", "String") -> w2
  for {
    w3 = each element of w1
    w4 = each element of w2
    call "Open Tag.gvi"(path=w3, data type=w4, error in=$"error in", configuration=$configuration) -> (tag=w6, error out=w7)
    append w6 to w5
    stop if w7
  }
  $tags <- w5
  $"error out" <- w7
