vi "createCardTag.gvi"   [LabVIEW NXG 4.0.0]
panel controls:
  "password": string
  "username": string
  "server url": string
  "error in": error
panel indicators:
  "error out": error
  "tags": "Tag.gtype"[]
  "Output": string[]
types:
  "DataType.gtype" = enum{"Double", "I32", "String", "Boolean", "U64", "Timestamp"}
  "Client Handle.gtype" = u32
  "Configuration.gtype" = cluster{"Server URL": string, "Session": "Client Handle.gtype"}
  "Tag.gtype" = cluster{"Path": string, "Datatype": "DataType.gtype", "Configuration": "Configuration.gtype"}
uses:
  NI::Skyline::Configuration::Open Configuration.gvi
  NI::Skyline::TagHTTP::Open Tag.gvi
diagram:
  s1 = string[] []  # shift register
  for (N = 8) (iteration -> i1) {
    w1 = ["SystemLink.Dashboard.Card.Visible.Card", "SystemLink.Dashboard.Card.FullName.Card", "SystemLink.Dashboard.Card.StateColor.Card", "SystemLink.Dashboard.Card.ProgressBar.Card", "SystemLink.Dashboard.Card.TimeInState.Card", "SystemLink.Dashboard.Card.PhotoPath.Card", "", "", "", "", "", "", "", "", "", "", "", "", "", ""]
    s2 = s1  # shift register
    for (N = 6) {
      w2 = each element of w1
      Increment(x=i1) -> w3
      Number To Decimal String(number=w3) -> (decimal integer string=w4)
      Concatenate Strings(w2, w4) -> w5
      Insert Into Array(inArray=s2, new=w5) -> w6
      next s2 = w6
    }
    next s1 = s2
  }
  $Output <- s1
  call "Open Configuration.gvi"(server url=$"server url", username=$username, password=$password, error in=$"error in") -> (configuration=w7, error out=w8)
  Build Array("String", "String", "String", "String", "String", "String") -> w9
  for {
    w10 = each element of s1
    w11 = each element of w9
    call "Open Tag.gvi"(path=w10, data type=w11, error in=w8, configuration=w7) -> (tag=w13, error out=w14)
    append w13 to w12
    stop if w14
  }
  $tags <- w12
  $"error out" <- w14
