vi "name2pic.gvi"   [LabVIEW NXG 4.0.0]
inputs:
  "name": string
  "error in": error
outputs:
  "PhotoPath": string
  "error out": error
diagram:
  Search And Replace String(error in (no error)=$"error in", input string=$name, replace all (F)=TRUE, replace string ("")="%20", search string=" ") -> (error out=w1, result string=w2)
  Concatenate Strings("Photos/", w2, ".jpg") -> w3
  $PhotoPath <- w3
  $"error out" <- w1
