vi "readCardTag.gvi"   [LabVIEW NXG 4.0.0]
inputs:
  "tags in": "Tag.gtype"[]
  "error in": error
outputs:
  "tags out": "Tag.gtype"[]
  "errror out": error
  "state cluster": T1
types:
  "DataType.gtype" = enum{"Double", "I32", "String", "Boolean", "U64", "Timestamp"}
  "Client Handle.gtype" = u32
  "Configuration.gtype" = cluster{"Server URL": string, "Session": "Client Handle.gtype"}
  "Tag.gtype" = cluster{"Path": string, "Datatype": "DataType.gtype", "Configuration": "Configuration.gtype"}
  T1 = cluster{"Element 1": bool, "Element 2": string, "Element 3": i32, "Element 4": string, "Element 5": string, "Element 6": string}
uses:
  NI::Skyline::TagHTTP::Read Tag (Boolean).gvi
  NI::Skyline::TagHTTP::Read Tag (String).gvi
  NI::Skyline::TagHTTP::Read Tag (I32).gvi
diagram:
  case ($"error in") {
    frame Error, Default {
      w1 = $"tags in"
      w2 = default
      w3 = default
      w4 = default
      w5 = default
      w6 = default
      w7 = default
      w8 = $"error in"
    }
    frame No Error {
      Array Index(array=$"tags in") -> (out0[_]=w9, out1[_]=w10, out2[_]=w11, out3[_]=w12, out4[_]=w13, out5[_]=w14)
      call "Read Tag (Boolean).gvi"(tag in=w9, error in=$"error in") -> (value=w6, error out=w15)
      call "Read Tag (String).gvi"(tag in=w10, error in=$"error in") -> (value=w4, error out=w16)
      call "Read Tag (I32).gvi"(tag in=w11, error in=$"error in") -> (value=w5, error out=w17)
      call "Read Tag (String).gvi"(tag in=w12, error in=$"error in") -> (value=w2, error out=w18)
      call "Read Tag (String).gvi"(tag in=w13, error in=$"error in") -> (value=w7, error out=w19)
      call "Read Tag (String).gvi"(tag in=w14, error in=$"error in") -> (value=w3, error out=w20)
      Merge Errors(w15, w16, w17, w18, w19, w20) -> (error out=w8)
      w1 = $"tags in"
    }
  }
  $"tags out" <- w1
  Build Cluster(w6, w4, w5, w2, w7, w3) -> w21
  $"state cluster" <- w21
  $"errror out" <- w8
