vi "sendState.gvi"   [LabVIEW NXG 4.0.0]
inputs:
  "configuration": "Configuration.gtype"
  "All Talks": string
  "Start No.": i32
  "StateColor": string
  "State Array": T1[]
  "error in": error
  "loop count": i32
outputs:
  "errror out": error
types:
  "Client Handle.gtype" = u32
  "Configuration.gtype" = cluster{"Server URL": string, "Session": "Client Handle.gtype"}
  T1 = cluster{"Element 0": string, "Element 1": string, "Element 2": string, "Element 3": string, "Element 4": string, "Element 5": string, "Element 6": string}
uses:
  SubVIs::name2pic.gvi
  SubVIs::createCardTag.gvi
  SubVIs::time1.gvi
  SubVIs::writeCardTag.gvi
  NI::Skyline::TagHTTP::Close Tag (Multiple).gvi
diagram:
  for (N = $"loop count") (iteration -> i1) {
    w1 = each element of $"State Array"
    Property Node(instance in=w1) -> ("Element 0"=w2, "Element 5"=w3, "Element 6"=w4)
    call "name2pic.gvi"(name=w2, error in=$"error in") -> (PhotoPath=w5, error out=w6)
    Increment(x=i1) -> w7
    Add($"Start No.", w7) -> w8
    call "createCardTag.gvi"(configuration=$configuration, error in=$"error in", Card No=w8) -> (tags=w9, error out=w10)
    Decimal String To Number(string=$"All Talks") -> (number=w11)
    Is Equal To 0(x=w11) -> w12
    Decimal String To Number(string=w4) -> (number=w13)
    Divide(x=w13, y=w11) -> w14: f64
    Select(s=w12, t=0, f=w14) -> w15
    call "time1.gvi"(字符串=w3) -> (连接的字符串=w16)
    Merge Errors(w10, w6) -> (error out=w17)
    call "writeCardTag.gvi"(Visible=TRUE, FullName=w2, ProgressBar=w15, StateColor=$StateColor, TimeInState=w16, PhotoPath=w5, error in=w17, tags in=w9) -> (errror out=w18, tags out=w19)
    call "Close Tag (Multiple).gvi"(tags=w19, error in=w18) -> (error out=w20)
  }
  $"errror out" <- w20
