vi "writeCardTag.gvi"   [LabVIEW NXG 4.0.0]
inputs:
  "tags in": "Tag.gtype"[]
  "Visible": bool
  "FullName": string
  "ProgressBar": i32
  "StateColor": string
  "TimeInState": string
  "PhotoPath": string
  "error in": error
outputs:
  "errror out": error
  "tags out": "Tag.gtype"[]
types:
  "DataType.gtype" = enum{"Double", "I32", "String", "Boolean", "U64", "Timestamp"}
  "Client Handle.gtype" = u32
  "Configuration.gtype" = cluster{"Server URL": string, "Session": "Client Handle.gtype"}
  "Tag.gtype" = cluster{"Path": string, "Datatype": "DataType.gtype", "Configuration": "Configuration.gtype"}
uses:
  NI::Skyline::TagHTTP::Write Tag (Boolean).gvi
  NI::Skyline::TagHTTP::Write Tag (String).gvi
  NI::Skyline::TagHTTP::Write Tag (I32).gvi
diagram:
  case ($"error in") {
    frame Error, Default {
      w1 = $"error in"
      w2 = $"tags in"
    }
    frame No Error {
      Array Index(array=$"tags in") -> (out0[_]=w3, out1[_]=w4, out2[_]=w5, out3[_]=w6, out4[_]=w7, out5[_]=w8)
      call "Write Tag (Boolean).gvi"(tag in=w3, value=$Visible, error in=$"error in") -> (error out=w9)
      call "Write Tag (String).gvi"(tag in=w4, value=$FullName, error in=$"error in") -> (error out=w10)
      call "Write Tag (I32).gvi"(tag in=w5, value=$ProgressBar, error in=$"error in") -> (error out=w11)
      call "Write Tag (String).gvi"(tag in=w6, value=$StateColor, error in=$"error in") -> (error out=w12)
      call "Write Tag (String).gvi"(tag in=w7, value=$TimeInState, error in=$"error in") -> (error out=w13)
      call "Write Tag (String).gvi"(tag in=w8, value=$PhotoPath, error in=$"error in") -> (error out=w14)
      Merge Errors(w9, w10, w11, w12, w13, w14) -> (error out=w1)
      w2 = $"tags in"
    }
  }
  $"errror out" <- w1
  $"tags out" <- w2
