vi "createBasicTag.gvi"   [LabVIEW NXG 4.0.0]
inputs:
  "server url": string
  "username": string
  "password": string
  "error in": error
outputs:
  "error out": error
  "tags": "Tag.gtype"[]
types:
  "DataType.gtype" = enum{"Double", "I32", "String", "Boolean", "U64", "Timestamp"}
  "Client Handle.gtype" = u32
  "Configuration.gtype" = cluster{"Server URL": string, "Session": "Client Handle.gtype"}
  "Tag.gtype" = cluster{"Path": string, "Datatype": "DataType.gtype", "Configuration": "Configuration.gtype"}
uses:
  NI::Skyline::Configuration::Open Configuration.gvi
  NI::Skyline::TagHTTP::Open Tag.gvi
diagram:
  w1 = ["SystemLink.Dashboard.Basic.TimeStramp", "SystemLink.Dashboard.Basic.freeNum", "SystemLink.Dashboard.Basic.busyNum", "SystemLink.Dashboard.Basic.awayNum", "SystemLink.Dashboard.Basic.allTalks", "SystemLink.Dashboard.Basic.waitNum"]
  call "Open Configuration.gvi"(server url=$"server url", username=$username, password=$password, error in=$"error in") -> (configuration=w2, error out=w3)
  Build Array("String", "String", "String", "String", "String", "String") -> w4
  for {
    w5 = each element of w1
    w6 = each element of w4
    call "Open Tag.gvi"(path=w5, data type=w6, error in=w3, configuration=w2) -> (tag=w8, error out=w9)
    append w8 to w7
    stop if w9
  }
  $tags <- w7
  $"error out" <- w9
