vi "main.gvi"   [LabVIEW NXG 4.0.0]
panel controls:
  "error in": error
  "stop": bool
panel indicators:
  "error out": error
  "loop iteration": i32
  "loop iteration_2": i32
types:
  T1 = cluster{"Element 0": string, "Element 1": string, "Element 2": string, "Element 3": string, "Element 4": string, "Element 5": string, "Element 6": string}
uses:
  desktop::python.gvi
  desktop::text.gvi
  SubVIs::createBasicTag.gvi
  SubVIs::writeBasicTag.gvi
  NI::Skyline::TagHTTP::Close Tag (Multiple).gvi
  SubVIs::createCardTag.gvi
  SubVIs::time1.gvi
  SubVIs::name2pic.gvi
  SubVIs::writeCardTag.gvi
  NI::Skyline::Configuration::Open Configuration (Desktop).gvi
  NI::Skyline::TagHTTP::Open Tag.gvi
  NI::Skyline::TagHTTP::Write Tag (Boolean).gvi
  NI::Skyline::TagHTTP::Close Tag (Single).gvi
diagram:
  w1 = $"error in"
  while (iteration -> i1) {
    $"loop iteration" <- i1
    call "python.gvi"(error in=w1) -> (error out=w2)
    call "text.gvi"(error in=w2) -> (basicState Array=w3, aeState Array=w4, error out=w5)
    Array To Cluster[NumberOfClusterElements=6](array=w3) -> (cluster=w6)
    Property Node(instance in=w6) -> ("Element 1"=w7, "Element 2"=w8, "Element 3"=w9)
    Decimal String To Number(string=w8) -> (number=w10)
    Decimal String To Number(string=w9) -> (number=w11)
    Decimal String To Number(string=w7) -> (number=w12)
    Add(w12, w11) -> w13
    Add(w13, w10) -> w14
    Subtract(x=8, y=w14) -> w15
    Array Size(array=w4) -> (size(s)=w16)
    Array To Cluster[NumberOfClusterElements=9](array=w16) -> (cluster=w17)
    Property Node(instance in=w17) -> ("Element 0"=w18)
    s1 = T1[] []  # shift register
    s2 = T1[] []  # shift register
    s3 = T1[] []  # shift register
    for (N = w18) {
      w19 = each element of w4
      Array To Cluster[NumberOfClusterElements=7](array=w19) -> (cluster=w20)
      Property Node(instance in=w20) -> ("Element 4"=w21)
      case (w21) {
        frame "False", Default {
          w22 = s1
          w23 = s2
          w24 = s3
        }
        frame "Free" {
          Insert Into Array(inArray=s1, new=w20) -> w22
          w23 = s2
          w24 = s3
        }
        frame "Busy" {
          Insert Into Array(inArray=s3, new=w20) -> w24
          w22 = s1
          w23 = s2
        }
        frame "Away" {
          Insert Into Array(inArray=s2, new=w20) -> w23
          w22 = s1
          w24 = s3
        }
      }
      next s1 = w22
      next s2 = w23
      next s3 = w24
    }
    call "createBasicTag.gvi"(server url="http://sh-ae-board", username="admin", password="Dashboard", error in=w5) -> (tags=w25, error out=w26)
    call "writeBasicTag.gvi"(tags in=w25, Array=w3, error in=w26) -> (tags out=w27, errror out=w28)
    call "Close Tag (Multiple).gvi"(tags=w27, error in=w28) -> (error out=w29)
    for (N = w10) (iteration -> i2) {
      w30 = each element of s3
      Property Node(instance in=w30) -> ("Element 0"=w31, "Element 5"=w32, "Element 6"=w33)
      Increment(x=i2) -> w34
      Add(w12, w34) -> w35
      call "createCardTag.gvi"(server url="http://sh-ae-board", username="admin", password="Dashboard", error in=w29, Card No=w35) -> (tags=w36)
      Decimal String To Number(string=w33) -> (number=w37)
      call "time1.gvi"(字符串=w32) -> (连接的字符串=w38)
      call "name2pic.gvi"(name=w31, error in=w29) -> (PhotoPath=w39, error out=w40)
      call "writeCardTag.gvi"(Visible=TRUE, FullName=w31, ProgressBar=w37, StateColor="Resources/redCircle.png", TimeInState=w38, PhotoPath=w39, error in=w40, tags in=w36) -> (errror out=w41, tags out=w42)
      call "Close Tag (Multiple).gvi"(tags=w42, error in=w41) -> (error out=w43)
    }
    for (N = w11) (iteration -> i3) {
      w44 = each element of s2
      Property Node(instance in=w44) -> ("Element 0"=w45, "Element 5"=w46, "Element 6"=w47)
      Increment(x=i3) -> w48
      Add(w12, w48) -> w49
      Add(w10, w49) -> w50
      call "createCardTag.gvi"(server url="http://sh-ae-board", username="admin", password="Dashboard", error in=w29, Card No=w50) -> (tags=w51)
      Decimal String To Number(string=w47) -> (number=w52)
      call "time1.gvi"(字符串=w46) -> (连接的字符串=w53)
      call "name2pic.gvi"(name=w45, error in=w29) -> (PhotoPath=w54, error out=w55)
      call "writeCardTag.gvi"(Visible=TRUE, FullName=w45, ProgressBar=w52, StateColor="Resources/yellowCircle.png", TimeInState=w53, PhotoPath=w54, error in=w55, tags in=w51) -> (errror out=w56, tags out=w57)
      call "Close Tag (Multiple).gvi"(tags=w57, error in=w56) -> (error out=w58)
    }
    for (N = w12) (iteration -> i4) {
      w59 = each element of s1
      Property Node(instance in=w59) -> ("Element 0"=w60, "Element 5"=w61, "Element 6"=w62)
      Increment(x=i4) -> w63
      call "createCardTag.gvi"(server url="http://sh-ae-board", username="admin", password="Dashboard", error in=w29, Card No=w63) -> (tags=w64)
      Decimal String To Number(string=w62) -> (number=w65)
      call "time1.gvi"(字符串=w61) -> (连接的字符串=w66)
      call "name2pic.gvi"(name=w60, error in=w29) -> (PhotoPath=w67, error out=w68)
      call "writeCardTag.gvi"(Visible=TRUE, FullName=w60, ProgressBar=w65, StateColor="Resources/greenCircle.png", TimeInState=w66, PhotoPath=w67, error in=w68, tags in=w64) -> (errror out=w69, tags out=w70)
      call "Close Tag (Multiple).gvi"(tags=w70, error in=w69) -> (error out=w71)
    }
    Merge Errors(w43, w58, w71) -> (error out=w72)
    s4 = w72  # shift register
    for (N = w15) (iteration -> i5) {
      Subtract(x=8, y=i5) -> w73
      Number To Decimal String(number=w73) -> (decimal integer string=w74)
      Concatenate Strings("SystemLink.Dashboard.Card.Visible.Card", w74) -> w75
      call "Open Configuration (Desktop).gvi"(server url="http://sh-ae-board", username="admin", password="Dashboard", error in=s4) -> (configuration=w76, error out=w77)
      call "Open Tag.gvi"(path=w75, data type="Boolean", error in=w77, configuration=w76) -> (tag=w78, error out=w79)
      call "Write Tag (Boolean).gvi"(tag in=w78, value=FALSE, error in=w79) -> (tag out=w80, error out=w81)
      call "Close Tag (Single).gvi"(tag=w80, error in=w81) -> (error out=w82)
      next s4 = w82
    }
    stop if $stop
  }
  $"error out" <- s4
  while (iteration -> i6) (after w1) {
    Wait(time to wait=1000)
    $"loop iteration_2" <- i6
    stop if $stop
  }
