vi "python.gvi"   [LabVIEW NXG 4.0.0]
inputs:
  "error in": error
outputs:
  "error out": error
uses:
  NI::G Core::Libraries and Executables::System Exec.gvi
diagram:
  Get Component Directory() -> (Path=w1)
  Strip Path(path=w1) -> (stripped path=w2)
  Strip Path(path=w2) -> (stripped path=w3)
  call "System Exec.gvi"(run minimized?=TRUE, command line="python .\\Data\\main.py", working directory=w3, error in=$"error in", wait until completion?=TRUE) -> (error out=w4)
  $"error out" <- w4
