vi "tag.gvi"   [LabVIEW NXG 4.0.0]
panel controls:
  "error in": error
  "time stamp": timestamp
  "Button": bool
  "String": string
panel indicators:
  "error out": error
  "loop iteration": i32
uses:
  NI::Skyline::Configuration::Open Configuration.gvi
  NI::Skyline::TagHTTP::Open Tag.gvi
  NI::Skyline::TagHTTP::Write Tag (I32).gvi
  NI::Skyline::Configuration::Close Configuration.gvi
diagram:
  call "Open Configuration.gvi"(server url="http://sh-ae-board", username="admin", password="Dashboard", error in=$"error in") -> (configuration=w1, error out=w2)
  call "Open Tag.gvi"(path="SystemLink.Dashboard.test", data type="I32", error in=w2, configuration=w1) -> (tag=w3, error out=w4)
  while (iteration -> i1) {
    Wait(time to wait=100)
    $"loop iteration" <- i1
    call "Write Tag (I32).gvi"(tag in=w3, value=i1, time stamp=$"time stamp", error in=w4) -> (error out=w5)
    stop if FALSE
  }
  call "Close Configuration.gvi"(configuration=w1, error in=w5) -> (error out=w6)
  $"error out" <- w6
