vi "text.gvi"   [LabVIEW NXG 4.0.0]
inputs:
  "error in": error
outputs:
  "error out": error
  "aeState Array": string[][]
  "basicState Array": string[]
panel indicators:
  "x != y?": bool
uses:
  NI::G Core::Strings::Delimited String to 1D String Array.gvi
diagram:
  Get Component Directory() -> (Path=w1)
  Strip Path(path=w1) -> (stripped path=w2)
  Strip Path(path=w2) -> (stripped path=w3)
  Build Path(base path=w3, name or relative path="Data\\currentState.txt") -> (appended path=w4)
  Read From Text File(error in=$"error in", file (use dialog)=w4) -> (error out=w5, text=w6)
  call "Delimited String to 1D String Array.gvi"(delimited string=w6, delimiter="\n") -> (string array=w7)
  Split 1D Array(array=w7, index=6) -> (first subarray=w8, second subarray=w9)
  $"basicState Array" <- w8
  Array Size(array=w9) -> (size(s)=w10)
  Quotient And Remainder(x=w10, y=7) -> (floor(x/y)=w11, x-y*floor(x/y)=w12)
  Is Not Equal(x=w12, y=0) -> w13
  $"x != y?" <- w13
  Reshape Array(inArray=w9, size=w11, size=7) -> w14
  $"aeState Array" <- w14
  $"error out" <- w5
